# Grasshopper definition Flowing Cities.gh (Grasshopper 1.0.7)
# plug-ins: Kangaroo2 Components

number_slider = Slider(7, range=0..100)  # disabled
number_slider_2 = Slider(20, range=0..100)  # disabled
box = CenterBox(Base=PlaneXY(0, 0, 0), X=number_slider, Y=number_slider, Z=number_slider)  # disabled
pop3d = Populate3D(Region=box, Count=number_slider_2, Seed=1)  # disabled
pt = Point(pop3d)  # disabled
pt_2 = Point([Point(-2.884844584, 2.153879053, 3.594346557), Point(2.981599895, 8.408290099, -2.821508857), Point(13.1312816, -0.2517753085, -0.2437687187), Point(5.056390435, 6.232571075, 6.608695788), Point(0.3321291635, 3.81001968, 5.996186582), Point(-5.571094306, 10.6000979, -6.884847532)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])

allowed_dist_build = Slider(2, range=0..10)
density_of_park_planes = Slider(0.5, range=0..1)
window_coef = Slider(0.7, range=0..1)
park_coef = Slider(0.2, range=0..1)

get_point = GetPoint(pt_2, AtLeast=1, AtMost=500, Realtime=True)

lng = ListLength(List=get_point)
dom = ConstructDomain(DomainStart=0, DomainEnd=expr("x-1", lng))
range = Range(Domain=dom, Steps=expr("x-1", lng))
cull_i = CullIndex(List=get_point, Indices=graft(range), Wrap=True)  # -> simplify(List)
dist = Distance(PointA=simplify(graft(get_point)), PointB=cull_i)  # -> simplify(Distance)
expression = Expression(x=allowed_dist_build, Expression="x*2")
smaller = SmallerThan(FirstNumber=dist, SecondNumber=expression)  # -> SmallerThan, OrEqualTo
pt_3 = Point(get_point)
cull = CullPattern(List=cull_i, CullPattern=smaller.SmallerThan)
ma = MassAddition(Input=smaller.SmallerThan)  # -> Result, PartialResults
index = ItemIndex(List=pt_3, Item=flatten(cull))
bool = Boolean(ma.Result)
cull_2 = CullPattern(List=graft(get_point), CullPattern=bool)
merge = Merge(Data1=cull, Data2=simplify(cull_2))
avr = Average(Input=merge)  # -> flatten(ArithmeticMean)
cull_i_2 = CullIndex(List=pt_3, Indices=index, Wrap=True)
null = NullItem(Item=avr)  # -> NullFlags, InvalidFlags, Description
cull_3 = CullPattern(List=avr, CullPattern=invert(null.NullFlags))
duppt = RemoveDuplicatePts(Points=cull_3, Tolerance=0.01)
merge_2 = Merge(Data1=flatten(cull_i_2), Data2=flatten(duppt))

number_slider_3 = Slider(1, range=0..1)
number_slider_4 = Slider(1, range=0..1)
number_slider_5 = Slider(1.5, range=0..10)
box_2 = CenterBox(Base=cull_i_2, X=number_slider_3, Y=number_slider_3, Z=allowed_dist_build)
box_3 = CenterBox(Base=duppt, X=number_slider_5, Y=number_slider_5, Z=allowed_dist_build)
merge_3 = Merge(Data1=box_2, Data2=box_3)

debrep = DeconstructBrep(Brep=merge_3)  # -> reparameterize(simplify(Faces)), Edges, Vertices
panel = Panel("""0
1
2
3""")
item = ListItem(List=debrep.Faces, Index=panel, Wrap=True)
divide = DivideDomain²(Domain=simplify(item), UCount=Slider(5, range=0..10), VCount=Slider(5, range=0..10))
subsrf = Isotrim(Surface=reparameterize(simplify(graft(item))), Domain=divide)  # -> simplify(Surface)
debrep_2 = DeconstructBrep(Brep=subsrf)  # -> flatten(Faces), Edges, Vertices
lng_2 = ListLength(List=debrep_2.Faces)
multiplication = Multiplication(A=lng_2, B=window_coef)
reduce = RandomReduce(List=debrep_2.Faces, Reduction=multiplication, Seed=1)
area = Area(Geometry=reduce)  # -> Area, Centroid
scale = Scale(Geometry=reduce, Center=area.Centroid, Factor=Slider(0.8, range=0..1))  # -> Geometry, Transform
vec = Vector(scale.Geometry)
amp = Amplitude(Vector=vec, Amplitude=Slider(0.01, range=0..0.01))
move = Move(Geometry=scale.Geometry, Motion=amp)  # -> Geometry, Transform

Z = UnitZ(Factor=expr("-x+1", allowed_dist_build))
move_2 = Move(Geometry=merge_2, Motion=Z)  # -> Geometry, Transform
prox = Proximity3D(Points=move_2.Geometry, Group=Slider(2, range=0..10))  # -> flatten(Links), Topology
lng_3 = ListLength(List=prox.Links)
multiplication_2 = Multiplication(A=lng_3, B=Slider(0.4, range=0..1))
reduce_2 = RandomReduce(List=prox.Links, Reduction=multiplication_2, Seed=1)
xy = XYPlane(Origin=Point(0, 0, 0))
offset = OffsetCurve(Curve=reduce_2, Distance="0.2", Plane=xy, Corners=1)
offset_2 = OffsetCurve(Curve=reduce_2, Distance="-0.2", Plane=xy, Corners=1)
loft = Loft(
    Curves=[offset_2, offset],
    Options={Adjust=False, Closed=False, LoftEnds=0, LoftSimp=0, LoftType=0, Rebuild=10, Refit=0.01})
swatch = ColourSwatch(SwatchColor=RGB(247, 202, 107))
preview = CustomPreview(Geometry=merge_3, Material=swatch)
preview_2 = CustomPreview(Geometry=loft, Material=swatch)

move_3 = Move(Geometry=merge_2, Motion="0,0,-2")  # -> Geometry, Transform

lng_4 = ListLength(List=move_3.Geometry)
multiplication_3 = Multiplication(A=lng_4, B=density_of_park_planes)
reduce_3 = RandomReduce(List=move_3.Geometry, Reduction=multiplication_3, Seed=1)
xy_2 = XYPlane(Origin=reduce_3)
metaball_t = MetaBallT(Points=move_3.Geometry, Plane=graft(xy_2), Threshold=park_coef)  # -> flatten(Isocurve)
boundary = BoundarySurfaces(Edges=metaball_t)
Z_2 = UnitZ(Factor="-0.2")
extr = Extrude(Base=boundary, Direction=Z_2)
preview_3 = CustomPreview(Geometry=[boundary, extr], Material=ColourSwatch(SwatchColor=RGB(23, 84, 12)))

mesh = MeshBrep(
    Brep=extr,
    Settings={GridMaxCount=0, GridMinCount=16, JaggedSeams=False, MaxEdgeLength=0, MinEdgeLength=0.0001, MinTolerance=0, Refine=True, RefineAngle=0, RelativeTolerance=0.65, SimplePlanes=True, Tolerance=0})
mesh_2 = MeshBrep(
    Brep=move.Geometry,
    Settings={GridMaxCount=0, GridMinCount=16, JaggedSeams=False, MaxEdgeLength=0, MinEdgeLength=0.0001, MinTolerance=0, Refine=True, RefineAngle=0, RelativeTolerance=0.65, SimplePlanes=True, Tolerance=0})
rh_out_greensrf = Mesh(mesh)

# ---- group: RH_OUT:Bridges
mesh_3 = Mesh(loft)

# ---- group: RH_OUT:Windows
mesh_4 = Mesh(mesh_2)

# ---- group: RH_OUT:Buildings
mesh_5 = Mesh(merge_3)
